# Grasshopper definition blob_voxels_gmassabni.gh (Grasshopper 1.0.7)
# plug-ins: VoxelTools

volume_size_dimension = Slider(38, range=0..100)
volume_size = GetNumber(volume_size_dimension, AtLeast=1, AtMost=1, Maximum=1.797693135e+308, Minimum=-1.797693135e+308, TreeAccess=False)
rectangle = Rectangle(Plane=PlaneXY(0, 0, 0), XSize=volume_size, YSize=volume_size, Radius=0)  # -> Rectangle, Length
point_1_move_in_x_direction = Slider(27.9, range=0..50)
point_1_move_in_y_direction = Slider(44.6, range=0..50)
point_1_move_in_z_direction = Slider(22, range=0..50)
point_2_move_in_x_direction = Slider(30, range=0..50)
point_2_move_in_y_direction = Slider(24.8, range=0..50)
point_2_move_in_z_direction = Slider(25, range=0..50)
point_3_move_in_x_direction = Slider(13.6, range=0..50)
point_3_move_in_y_direction = Slider(22.1, range=0..50)
point_3_move_in_z_direction = Slider(15.5, range=0..50)
box_rectangle = BoxRectangle(Rectangle=rectangle.Rectangle, Height=volume_size)
cell_size_dimension = Slider(6, range=1..10)
point_3_move_in_z = GetNumber(point_3_move_in_z_direction, AtLeast=1, AtMost=1, Maximum=1.797693135e+308, Minimum=-1.797693135e+308, TreeAccess=False)
point_3_move_in_y = GetNumber(point_3_move_in_y_direction, AtLeast=1, AtMost=1, Maximum=1.797693135e+308, Minimum=-1.797693135e+308, TreeAccess=False)
point_3_move_in_x = GetNumber(point_3_move_in_x_direction, AtLeast=1, AtMost=1, Maximum=1.797693135e+308, Minimum=-1.797693135e+308, TreeAccess=False)
point_2_move_in_y = GetNumber(point_2_move_in_y_direction, AtLeast=1, AtMost=1, Maximum=1.797693135e+308, Minimum=-1.797693135e+308, TreeAccess=False)
point_2_move_in_z = GetNumber(point_2_move_in_z_direction, AtLeast=1, AtMost=1, Maximum=1.797693135e+308, Minimum=-1.797693135e+308, TreeAccess=False)
point_1_move_in_y = GetNumber(point_1_move_in_y_direction, AtLeast=1, AtMost=1, Maximum=1.797693135e+308, Minimum=-1.797693135e+308, TreeAccess=False)
point_2_move_in_x = GetNumber(point_2_move_in_x_direction, AtLeast=1, AtMost=1, Maximum=1.797693135e+308, Minimum=-1.797693135e+308, TreeAccess=False)
point_1_move_in_x = GetNumber(point_1_move_in_x_direction, AtLeast=1, AtMost=1, Maximum=1.797693135e+308, Minimum=-1.797693135e+308, TreeAccess=False)
point_1_move_in_z = GetNumber(point_1_move_in_z_direction, AtLeast=1, AtMost=1, Maximum=1.797693135e+308, Minimum=-1.797693135e+308, TreeAccess=False)
cell_size = GetNumber(cell_size_dimension, AtLeast=1, AtMost=1, Maximum=1.797693135e+308, Minimum=-1.797693135e+308, TreeAccess=False)
create_voxelgrid = CreateVoxelGrid(BoundingBox=box_rectangle, SizeX=cell_size, SizeY=cell_size, SizeZ=cell_size)
distance_points_to_length = Slider(24, range=0..100)
construct_point = ConstructPoint(XCoordinate=point_2_move_in_x, YCoordinate=point_2_move_in_y, ZCoordinate=point_2_move_in_z)
construct_point_2 = ConstructPoint(XCoordinate=point_3_move_in_x, YCoordinate=point_3_move_in_y, ZCoordinate=point_3_move_in_z)
construct_point_3 = ConstructPoint(XCoordinate=point_1_move_in_x, YCoordinate=point_1_move_in_y, ZCoordinate=point_1_move_in_z)
distance_to_points = GetNumber(distance_points_to_length, AtLeast=1, AtMost=1, Maximum=1.797693135e+308, Minimum=-1.797693135e+308, TreeAccess=False)
voxelategeometry = VoxelateGeometry(
    Geometry=[construct_point_2, construct_point, construct_point_3],
    VoxelGrid=create_voxelgrid,
    Distance=distance_to_points)
voxelgrid_to_mesh_hull = VoxelGridToMeshHull(VoxelGrid=voxelategeometry, FakeShadow=Toggle(True))  # -> Mesh, X, X_2, Y, Y_2, Z, Z_2
subd = SubD(voxelgrid_to_mesh_hull.Mesh)
context_bake = ContextBake(BlobVoxels=subd)
